# Grasshopper definition RecursivePavillion.gh (Grasshopper 1.0.8)
# plug-ins: RhinoCodePluginGH

height = Slider(4, range=0..10)
get_number = GetNumber(Slider(20.4, range=0..100), AtLeast=1, AtMost=1, Maximum=1.797693135e+308, Minimum=-1.797693135e+308, TreeAccess=False)
get_integer = GetInteger(Slider(90, range=0..90), AtLeast=1, AtMost=1, Maximum=2147483647, Minimum=-2147483648, TreeAccess=False)
get_number_2 = GetNumber(Slider(0.5, range=0..1), AtLeast=1, AtMost=1, Maximum=1.797693135e+308, Minimum=-1.797693135e+308, TreeAccess=False)
get_integer_2 = GetInteger(Slider(11, range=0..20), AtLeast=1, AtMost=1, Maximum=2147483647, Minimum=-2147483648, TreeAccess=False)
get_number_3 = GetNumber(height, AtLeast=1, AtMost=1, Maximum=1.797693135e+308, Minimum=-1.797693135e+308, TreeAccess=False)
get_number_4 = GetNumber(Slider(0.33, range=0..1), AtLeast=1, AtMost=1, Maximum=1.797693135e+308, Minimum=-1.797693135e+308, TreeAccess=False)
get_number_5 = GetNumber(Slider(20.4, range=0..100), AtLeast=1, AtMost=1, Maximum=1.797693135e+308, Minimum=-1.797693135e+308, TreeAccess=False)
rectangle = Rectangle(Plane=PlaneXY(0, 0, 0), XSize=get_number_5, YSize=get_number, Radius=0)  # -> Rectangle, Length

# ---- group: forming outside edges
explode = Explode(Curve=rectangle.Rectangle, Recursive=True)  # -> Segments, Vertices
offset = OffsetCurve(Curve=explode.Segments, Distance=get_number_3, Corners=1)  # -> flatten(Curve)
end = EndPoints(Curve=explode.Segments)  # -> Start, End
end_2 = EndPoints(Curve=offset)  # -> Start, End
ln = Line(StartPoint=end.End, EndPoint=end_2.End)
ln_2 = Line(StartPoint=end.Start, EndPoint=end_2.Start)
entwine = Entwine(Branch00=ln_2, Branch01=ln, Branch02=explode.Segments, Branch03=offset, FlattenInputs=True)
flip = FlipMatrix(Data=entwine)
tstat = TreeStatistics(Tree=flip)  # -> Paths, Length, Count
item = ListItem(List=tstat.Paths, Index=0, Wrap=True)
branch = TreeBranch(Tree=flip, Path=item, MaintainPaths=True)

# ----
crv = Curve(flip)
crv_2 = Curve(rectangle.Rectangle)
join = JoinCurves(Curves=crv, Preserve=False)  # -> flatten(Curves)
algorithm = Python3Script(init_square=crv_2, num_iterations=get_integer_2, param1=get_number_2, param2=get_number_4)  # -> out, connecting_lines, new_square; inputs init_square: GeometryBase, num_iterations: Int32
# ---------- algorithm: Python ----------
import Rhino.Geometry as rg
import ghpythonlib.components as ghc
import math
from ghpythonlib.treehelpers import list_to_tree

def get_point_on_curve(curve, parameter):
    """Get a point at a specified normalized parameter along a curve"""
    return curve.PointAtNormalizedLength(parameter)

def create_line_between_edges(edge1, edge2, param1, param2):
    """Create a line between two points on different edges"""
    point1 = get_point_on_curve(edge1, param1)
    point2 = get_point_on_curve(edge2, param2)
    return rg.Line(point1, point2)

def find_vector_intersection(line1, line2):
    """Find intersection of two lines using vector mathematics"""
    p1 = line1.From
    v1 = line1.Direction
    
    p2 = line2.From
    v2 = line2.Direction
    
    # Vector between starting points
    dp = rg.Vector3d(p2 - p1)
    
    # Calculate cross products
    v1_cross_v2 = rg.Vector3d.CrossProduct(v1, v2)
    dp_cross_v2 = rg.Vector3d.CrossProduct(dp, v2)
    
    # If vectors are parallel, return None
    if v1_cross_v2.Length < 1e-10:
        return None
        
    # Calculate intersection parameter
    t1 = dp_cross_v2.Length / v1_cross_v2.Length
    if v1_cross_v2.Z < 0:
        t1 = -t1
        
    # Calculate intersection point
    intersection = p1 + v1 * t1
    return intersection

def get_connecting_lines_and_squares(square,  param1, param2):
    """Create connecting lines and find their intersections using vectors"""
    segments = square.DuplicateSegments()
    connecting_lines = []
    intersection_points = []
    
    # Get all connecting lines
    for i in range(len(segments)):
        current_edge = segments[i]
        next_edge = segments[(i + 1) % len(segments)]
        new_line = create_line_between_edges(
            current_edge,
            next_edge,
            param1,
            param2
        )
        connecting_lines.append(new_line)
    
    # Find intersections using vector mathematics
    for i in range(len(connecting_lines)):
        line1 = connecting_lines[i]
        line2 = connecting_lines[(i + 1) % len(connecting_lines)]
        intersection = find_vector_intersection(line1, line2)
        if intersection:
            intersection_points.append(intersection)
    
    # Create new square from intersection points
    if len(intersection_points) == 4:
        new_square = rg.PolylineCurve([
            intersection_points[0],
            intersection_points[1],
            intersection_points[2],
            intersection_points[3],
            intersection_points[0]
        ])
        return connecting_lines, new_square
    
    return connecting_lines, None

def recursive_square_generation(init_square, iterations, param1, param2):
    """Recursively generate squares and store all connecting lines and squares"""
    all_connecting_lines = []  # List to store all connecting lines
    all_squares = [init_square]  # List to store all squares, starting with initial square
    
    current_square = init_square
    for i in range(iterations):
        connecting_lines, new_square = get_connecting_lines_and_squares(current_square,  param1, param2)
        
        if connecting_lines:
            all_connecting_lines.append(connecting_lines)
        
        if new_square:
            all_squares.append(new_square)
            current_square = new_square
        else:
            break
    
    # Convert the connecting lines list to a data tree
    connecting_lines_tree = list_to_tree(all_connecting_lines)
    
    return connecting_lines_tree, all_squares

# Main execution
#num_iterations = 3  # Adjust this number for more or fewer iterations
connecting_lines_tree, squares = recursive_square_generation(init_square, num_iterations,param1, param2)

# Set outputs
connecting_lines = connecting_lines_tree  # All connecting lines as a data tree
new_square = squares  # All squares as a list
# ---------- end algorithm ----------
runion = RegionUnion(Curves=[join, crv_2])
number_slider = Slider(50, range=0..100)
panel = Panel(algorithm.connecting_lines)
crv_3 = Curve(algorithm.connecting_lines)
ext = ExtendCurve(Curve=crv_3, Type=0, Start=number_slider, End=number_slider)
trim = TrimWithRegion(Curve=flatten(ext), Region=runion)  # -> Inside, Outside
crv_4 = Curve(trim.Inside)
trim_2 = TrimWithRegion(Curve=flatten(crv_4), Region=graft(join))  # -> Inside, Outside
explode_2 = Explode(Curve=join, Recursive=True)  # -> Segments, Vertices
crv_5 = Curve(trim_2.Outside)
crv_6 = Curve(trim_2.Inside)
item_2 = ListItem(List=explode_2.Segments, Index=Slider(2, range=0..10), Wrap=True)
trim_3 = TrimWithRegion(Curve=flatten(crv_5), Region=crv_2)  # -> Inside, Outside
pshift = ShiftPaths(Data=crv_6, Offset=-1)
eval = EvaluateCurve(Curve=reparameterize(item_2), Parameter=Slider(0.5, range=0..1))  # -> Point, Tangent, Angle
vdis = VectorDisplay(Anchor=eval.Point, Vector=eval.Tangent)
Z = UnitZ(Factor=1)
xprod = CrossProduct(VectorA=eval.Tangent, VectorB=Z, Unitize=False)  # -> Vector, Length

# ---- group: rotate sides
rot3d = Rotate3D(Geometry=pshift, Angle=degrees(get_integer), Center=eval.Point, Axis=eval.Tangent)  # -> Geometry, Transform
crv_7 = Curve(rot3d.Geometry)

# ----
end_3 = EndPoints(Curve=graft(crv_7))  # -> Start, End
merge = Merge(Data1=end_3.Start, Data2=end_3.End)

# ---- group: structure roof
crv_8 = Curve(flatten(trim_3.Inside))
number_slider_2 = Slider(0.5, range=0..1)
number_slider_3 = Slider(0.02, range=0..1)
pframes = PerpFrames(Curve=crv_8, Count=Slider(1, range=0..1), Align=True)  # -> Frames, Parameters
item_3 = ListItem(List=pframes.Frames, Index=0, Wrap=True)
dom = ConstructDomain(DomainStart=expr("-x", number_slider_3), DomainEnd=number_slider_3)
dom_2 = ConstructDomain(DomainStart=number_slider_2, DomainEnd=Slider(0, range=0..1))
rectangle_2 = Rectangle(Plane=item_3, XSize=dom_2, YSize=dom, Radius=0)  # -> Rectangle, Length
offset_2 = OffsetCurve(Curve=crv_2, Distance=number_slider_2, Corners=1)
crv_9 = Curve(flatten(rectangle_2.Rectangle))
boundary = BoundarySurfaces(Edges=flatten([offset_2, crv_2]))
extrcrv = ExtrudeAlong(Base=crv_9, Curve=crv_8)
Z_2 = UnitZ(Factor=number_slider_3)
extr = Extrude(Base=boundary, Direction=Z_2)

# ----
pdecon = Deconstruct(Point=merge)  # -> XComponent, YComponent, ZComponent
sort = SortList(Keys=pdecon.ZComponent, ValuesA=merge)  # -> reverse(Keys), reverse(ValuesA)
panel_2 = Panel(sort.ValuesA)
item_4 = ListItem(List=sort.ValuesA, Index=0, Wrap=True)
graft = GraftTree(Tree=crv_7, IncludeEmptyLists=True, IncludeNullItems=True)
Z_3 = UnitZ(Factor=get_number_3)

# ---- group: structure at sides
vec = Vector(simplify(xprod.Vector))
number_slider_4 = Slider(0.5, range=0..1)
number_slider_5 = Slider(0.02, range=0..1)
dom_3 = ConstructDomain(DomainStart=expr("-x", number_slider_5), DomainEnd=number_slider_5)
dom_4 = ConstructDomain(DomainStart=number_slider_4, DomainEnd=Slider(0, range=0..1))

# ----
line = LineSDL(Start=item_4, Direction=Vector(0, 0, 1), Length=number_slider_4)
join_2 = JoinCurves(Curves=[graft, line], Preserve=False)  # -> simplify(Curves)
pshift_2 = ShiftPaths(Data=join_2, Offset=-1)

# ---- group: structure at sides (continued)
pframes_2 = PerpFrames(Curve=pshift_2, Count=Slider(1, range=0..1), Align=True)  # -> Frames, Parameters
item_5 = ListItem(List=pframes_2.Frames, Index=0, Wrap=True)
pshift_3 = ShiftPaths(Data=item_5, Offset=-1)
deplane = DeconstructPlane(Plane=pshift_3)  # -> Origin, XAxis, YAxis, ZAxis
pl = ConstructPlane(Origin=deplane.Origin, XAxis=vec, YAxis=deplane.YAxis)
rectangle_3 = Rectangle(Plane=pl, XSize=dom_4, YSize=dom_3, Radius=0)  # -> Rectangle, Length
crv_10 = Curve(rectangle_3.Rectangle)

# ----
crv_11 = Curve(pshift_2)
extrcrv_2 = ExtrudeAlong(Base=crv_10, Curve=crv_11)
geo = Geometry(flatten([extrcrv_2, extr, extrcrv]))
move = Move(Geometry=geo, Motion=Z_3)  # -> Geometry, Transform
geo_2 = Geometry(flatten(move.Geometry))
preview = CustomPreview(Geometry=move.Geometry, Material=ColourSwatch(SwatchColor=RGB(255, 255, 255)))
context_bake = ContextBake(Content=geo_2)
